# Requirement set RAVEN_Requirements (R2025b)

## 1 [#1] System Requirements (Container)

### 1.1 [SYS-FR-001] RAVEN shall autonomously execute a predefined reconnaissance mission along a programmable waypoint path without continuous operator input.
ReqParent: MISSION
Scope: [SYSTEM]
Section: System Requirements
Status: APPROVED

### 1.2 [SYS-FR-002] RAVEN shall produce a georeferenced fused data product combining RF spectrum data and LIDAR terrain mapping as the primary mission output.
ReqParent: MISSION
Scope: [SYSTEM]
Section: System Requirements
Status: APPROVED

### 1.3 [SYS-FR-003] RAVEN shall operate as a two-segment system consisting of a Ground Control Segment and an Aerial Vehicle Segment communicating over a defined data link.
ReqParent: MISSION
Scope: [SYSTEM]
Section: System Requirements
Status: APPROVED

### 1.4 [SYS-PR-001] RAVEN shall sustain autonomous flight for a minimum of 10 minutes under nominal operating conditions, with an objective of 20 minutes.
ReqParent: MISSION
Scope: [SYSTEM]
Section: System Requirements
Status: APPROVED

### 1.5 [SYS-PR-002] RAVEN shall maintain end-to-end command and telemetry latency not exceeding 500ms under nominal link conditions.
ReqParent: MISSION
Scope: [SYSTEM]
Section: System Requirements
Status: APPROVED

### 1.6 [SYS-IR-001] RAVEN shall provide a single-operator ground control interface capable of commanding, monitoring, and terminating a mission from one workstation.
ReqParent: MISSION
Scope: [SYSTEM]
Section: System Requirements
Status: APPROVED

## 2 [#8] GCS Mission Control (Container)

### 2.1 [GCS-MC-FR-001] The Mission Control subsystem shall provide a mission planning interface enabling the operator to define, modify, and upload waypoint paths to the AVS prior to flight.
ReqParent: SYS-FR-001
Scope: [GCS]
Section: GCS Mission Control
Status: APPROVED

### 2.2 [GCS-MC-FR-002] The Mission Control subsystem shall execute autonomous mission logic including waypoint sequencing, loiter commands, and return-to-launch without continuous operator input.
ReqParent: SYS-FR-001
Scope: [GCS]
Section: GCS Mission Control
Status: APPROVED

### 2.3 [GCS-MC-FR-003] The Mission Control subsystem shall monitor AVS system state and alert the operator to any off-nominal condition during flight.
ReqParent: SYS-IR-001
Scope: [GCS]
Section: GCS Mission Control
Status: APPROVED

### 2.4 [GCS-MC-FR-004] The Mission Control subsystem shall provide a mission abort command that triggers immediate return-to-launch on the AVS.
ReqParent: SYS-IR-001
Scope: [GCS]
Section: GCS Mission Control
Status: APPROVED

### 2.5 [GCS-MC-PR-001] The Mission Control subsystem shall display real-time AVS position, altitude, heading, and battery state at a minimum refresh rate of 2 Hz.
ReqParent: SYS-PR-002
Scope: [GCS]
Section: GCS Mission Control
Status: APPROVED

### 2.6 [GCS-MC-IR-001] The Mission Control subsystem shall interface with the Flight Telemetry subsystem via MAVLink protocol to send commands and receive AVS state data.
ReqParent: SYS-FR-003
Scope: [GCS]
Section: GCS Mission Control
Status: APPROVED

## 3 [#15] GCS Flight Telemetry (Container)

### 3.1 [GCS-FT-FR-001] The Flight Telemetry subsystem shall maintain a bidirectional data link with the AVS for the duration of each mission.
ReqParent: SYS-FR-003
Scope: [GCS]
Section: GCS Flight Telemetry
Status: APPROVED

### 3.2 [GCS-FT-FR-002] The Flight Telemetry subsystem shall detect and annunciate data link loss to the Mission Control subsystem within 1 second of link failure.
ReqParent: SYS-FR-003
Scope: [GCS]
Section: GCS Flight Telemetry
Status: APPROVED

### 3.3 [GCS-FT-PR-001] The Flight Telemetry subsystem shall sustain command and telemetry throughput sufficient to support MAVLink message rates at no less than 4 Hz.
ReqParent: SYS-PR-002
Scope: [GCS]
Section: GCS Flight Telemetry
Status: APPROVED

### 3.4 [GCS-FT-IR-001] The Flight Telemetry subsystem shall support WiFi as the primary link and shall be configurable to operate over RFD900x radio as a contingency link.
ReqParent: SYS-FR-003
Scope: [GCS]
Section: GCS Flight Telemetry
Status: APPROVED

## 4 [#20] GCS Data Processing (Container)

### 4.1 [GCS-DP-FR-001] The Data Processing subsystem shall ingest RTL-SDR IQ data streamed from the AVS and produce georeferenced RF spectrum snapshots tagged with position and timestamp.
ReqParent: SYS-FR-002
Scope: [GCS]
Section: GCS Data Processing
Status: APPROVED

### 4.2 [GCS-DP-FR-002] The Data Processing subsystem shall ingest LIDAR point cloud data from the AVS and produce a georeferenced terrain map.
ReqParent: SYS-FR-002
Scope: [GCS]
Section: GCS Data Processing
Status: APPROVED

### 4.3 [GCS-DP-FR-003] The Data Processing subsystem shall fuse georeferenced RF data and LIDAR terrain data into a single overlaid data product.
ReqParent: SYS-FR-002
Scope: [GCS]
Section: GCS Data Processing
Status: APPROVED

### 4.4 [GCS-DP-FR-004] The Data Processing subsystem shall display live RF spectrum data received from the AVS during flight.
ReqParent: SYS-IR-001
Scope: [GCS]
Section: GCS Data Processing
Status: APPROVED

### 4.5 [GCS-DP-PR-001] The Data Processing subsystem shall georeference all RF and LIDAR data to within a positional accuracy consistent with the onboard GPS solution.
ReqParent: SYS-FR-002
Scope: [GCS]
Section: GCS Data Processing
Status: APPROVED

### 4.6 [GCS-DP-IR-001] The Data Processing subsystem shall receive IQ data via rtl_tcp stream from the AVS Flight Computer over the active data link.
ReqParent: SYS-FR-003
Scope: [GCS]
Section: GCS Data Processing
Status: APPROVED

### 4.7 [GCS-DP-IR-002] The Data Processing subsystem shall receive LIDAR point cloud logs from the AVS Flight Computer via post-flight file transfer or live stream over the data link.
ReqParent: SYS-FR-003
Scope: [GCS]
Section: GCS Data Processing
Status: APPROVED

## 5 [#28] AVS Structures (Container)

### 5.1 [AVS-ST-FR-001] The Structures subsystem shall provide a rigid airframe capable of supporting all AVS subsystems including flight controller, flight computer, RF payload, and LIDAR payload during flight.
ReqParent: SYS-FR-003
Scope: [AVS]
Section: AVS Structures
Status: APPROVED

### 5.2 [AVS-ST-FR-002] The Structures subsystem shall provide dedicated mounting points for the LIDAR sensor with unobstructed downward field of view.
ReqParent: AVS-LI-FR-001
Scope: [AVS]
Section: AVS Structures
Status: APPROVED

### 5.3 [AVS-ST-FR-003] The Structures subsystem shall provide dedicated mounting for the RTL-SDR and antenna with RF line-of-sight clearance from the airframe.
ReqParent: AVS-RF-FR-001
Scope: [AVS]
Section: AVS Structures
Status: APPROVED

### 5.4 [AVS-ST-IR-001] The Structures subsystem shall conform to the F450 quadcopter frame form factor as the baseline airframe platform.
ReqParent: SYS-FR-003
Scope: [AVS]
Section: AVS Structures
Status: APPROVED

## 6 [#33] AVS Propulsion (Container)

### 6.1 [AVS-PR-FR-001] The Propulsion subsystem shall provide sufficient thrust to lift the fully loaded AVS including all payload and power systems.
ReqParent: SYS-PR-001
Scope: [AVS]
Section: AVS Propulsion
Status: APPROVED

### 6.2 [AVS-PR-FR-002] The Propulsion subsystem shall accept motor commands from the Flight Control subsystem via the flight controller ESC interface.
ReqParent: AVS-FC-IR-002
Scope: [AVS]
Section: AVS Propulsion
Status: APPROVED

### 6.3 [AVS-PR-PR-001] The Propulsion subsystem shall provide a thrust-to-weight ratio of not less than 2:1 at hover under full payload configuration.
ReqParent: SYS-PR-001
Scope: [AVS]
Section: AVS Propulsion
Status: APPROVED

### 6.4 [AVS-PR-PR-002] The Propulsion subsystem shall sustain nominal flight operations for the duration of SYS-PR-001 minimum flight time on a single battery charge.
ReqParent: SYS-PR-001
Scope: [AVS]
Section: AVS Propulsion
Status: APPROVED

### 6.5 [AVS-PR-IR-001] The Propulsion subsystem shall accept 4S LiPo power input from the Power subsystem via the power distribution board.
ReqParent: AVS-PW-FR-001
Scope: [AVS]
Section: AVS Propulsion
Status: APPROVED

## 7 [#39] AVS Flight Control (Container)

### 7.1 [AVS-FC-FR-001] The Flight Control subsystem shall execute autonomous waypoint navigation using ArduPilot firmware.
ReqParent: SYS-FR-001
Scope: [AVS]
Section: AVS Flight Control
Status: APPROVED

### 7.2 [AVS-FC-FR-002] The Flight Control subsystem shall execute a return-to-launch command upon receipt of an abort command from the GCS or upon data link loss exceeding the defined failsafe threshold.
ReqParent: GCS-MC-FR-004
Scope: [AVS]
Section: AVS Flight Control
Status: APPROVED

### 7.3 [AVS-FC-FR-003] The Flight Control subsystem shall perform attitude stabilization, altitude hold, and position hold using onboard IMU, barometer, and GPS inputs.
ReqParent: SYS-FR-001
Scope: [AVS]
Section: AVS Flight Control
Status: APPROVED

### 7.4 [AVS-FC-FR-004] The Flight Control subsystem shall accept mission waypoint uploads from the GCS via MAVLink.
ReqParent: GCS-MC-FR-001
Scope: [AVS]
Section: AVS Flight Control
Status: APPROVED

### 7.5 [AVS-FC-PR-001] The Flight Control subsystem shall maintain position hold within 2 meters of commanded position under nominal wind conditions.
ReqParent: SYS-PR-001
Scope: [AVS]
Section: AVS Flight Control
Status: APPROVED

### 7.6 [AVS-FC-IR-001] The Flight Control subsystem shall interface with the Flight Computer subsystem via MAVLink over serial UART.
ReqParent: SYS-FR-003
Scope: [AVS]
Section: AVS Flight Control
Status: APPROVED

### 7.7 [AVS-FC-IR-002] The Flight Control subsystem shall interface with the Propulsion subsystem via PWM or DSHOT ESC protocol.
ReqParent: AVS-PR-FR-002
Scope: [AVS]
Section: AVS Flight Control
Status: APPROVED

## 8 [#47] AVS Flight Computer (Container)

### 8.1 [AVS-CP-FR-001] The Flight Computer subsystem shall operate as a headless companion computer executing the UAV daemon software.
ReqParent: SYS-FR-003
Scope: [AVS]
Section: AVS Flight Computer
Status: APPROVED

### 8.2 [AVS-CP-FR-002] The Flight Computer subsystem shall bridge MAVLink telemetry between the Flight Control subsystem and the GCS.
ReqParent: GCS-FT-FR-001
Scope: [AVS]
Section: AVS Flight Computer
Status: APPROVED

### 8.3 [AVS-CP-FR-003] The Flight Computer subsystem shall serve RTL-SDR IQ data to the GCS via rtl_tcp over the active data link.
ReqParent: GCS-DP-IR-001
Scope: [AVS]
Section: AVS Flight Computer
Status: APPROVED

### 8.4 [AVS-CP-FR-004] The Flight Computer subsystem shall log LIDAR point cloud data with timestamps for post-flight processing.
ReqParent: GCS-DP-IR-002
Scope: [AVS]
Section: AVS Flight Computer
Status: APPROVED

### 8.5 [AVS-CP-FR-005] The Flight Computer subsystem shall tag all sensor data with GPS coordinates via GPSd.
ReqParent: SYS-FR-002
Scope: [AVS]
Section: AVS Flight Computer
Status: APPROVED

### 8.6 [AVS-CP-FR-006] The Flight Computer subsystem shall implement graceful fault handling for data link loss and sensor dropout without interrupting flight operations.
ReqParent: GCS-FT-FR-002
Scope: [AVS]
Section: AVS Flight Computer
Status: APPROVED

### 8.7 [AVS-CP-IR-001] The Flight Computer subsystem shall be implemented on a Raspberry Pi 5 4GB as the baseline hardware platform.
ReqParent: SYS-FR-003
Scope: [AVS]
Section: AVS Flight Computer
Status: APPROVED

### 8.8 [AVS-CP-IR-002] The Flight Computer subsystem shall receive power from the Power subsystem via 5V BEC from the UAV battery bus during flight.
ReqParent: AVS-PW-FR-002
Scope: [AVS]
Section: AVS Flight Computer
Status: APPROVED

## 9 [#56] AVS RF SDR (Container)

### 9.1 [AVS-RF-FR-001] The RF subsystem shall capture IQ samples across a configurable frequency range during flight.
ReqParent: SYS-FR-002
Scope: [AVS]
Section: AVS RF SDR
Status: APPROVED

### 9.2 [AVS-RF-FR-002] The RF subsystem shall stream captured IQ data to the Flight Computer via USB for forwarding to the GCS.
ReqParent: AVS-CP-FR-003
Scope: [AVS]
Section: AVS RF SDR
Status: APPROVED

### 9.3 [AVS-RF-PR-001] The RF subsystem shall support a minimum instantaneous receive bandwidth of 2.4 MHz.
ReqParent: SYS-FR-002
Scope: [AVS]
Section: AVS RF SDR
Status: APPROVED

### 9.4 [AVS-RF-PR-002] The RF subsystem shall operate across a tunable frequency range of 500 kHz to 1.766 GHz.
ReqParent: SYS-FR-002
Scope: [AVS]
Section: AVS RF SDR
Status: APPROVED

### 9.5 [AVS-RF-IR-001] The RF subsystem shall be implemented using the RTL-SDR Blog V4 as the baseline SDR hardware.
ReqParent: SYS-FR-003
Scope: [AVS]
Section: AVS RF SDR
Status: APPROVED

### 9.6 [AVS-RF-IR-002] The RF subsystem shall connect to the Flight Computer via USB interface.
ReqParent: AVS-CP-FR-003
Scope: [AVS]
Section: AVS RF SDR
Status: APPROVED

## 10 [#63] AVS LIDAR (Container)

### 10.1 [AVS-LI-FR-001] The LIDAR subsystem shall continuously capture 2D point cloud scans of terrain below the AVS during flight.
ReqParent: SYS-FR-002
Scope: [AVS]
Section: AVS LIDAR
Status: APPROVED

### 10.2 [AVS-LI-FR-002] The LIDAR subsystem shall log all point cloud data with timestamps to the Flight Computer for georeferencing.
ReqParent: AVS-CP-FR-004
Scope: [AVS]
Section: AVS LIDAR
Status: APPROVED

### 10.3 [AVS-LI-PR-001] The LIDAR subsystem shall achieve a minimum scan range of 6 meters under nominal operating conditions.
ReqParent: SYS-FR-002
Scope: [AVS]
Section: AVS LIDAR
Status: APPROVED

### 10.4 [AVS-LI-PR-002] The LIDAR subsystem shall operate at a minimum scan frequency of 5.5 Hz.
ReqParent: SYS-FR-002
Scope: [AVS]
Section: AVS LIDAR
Status: APPROVED

### 10.5 [AVS-LI-IR-001] The LIDAR subsystem shall be implemented using the RPLidar A1M8 as the baseline sensor.
ReqParent: SYS-FR-003
Scope: [AVS]
Section: AVS LIDAR
Status: APPROVED

### 10.6 [AVS-LI-IR-002] The LIDAR subsystem shall interface with the Flight Computer via USB.
ReqParent: AVS-CP-FR-004
Scope: [AVS]
Section: AVS LIDAR
Status: APPROVED

## 11 [#70] AVS Power (Container)

### 11.1 [AVS-PW-FR-001] The Power subsystem shall provide primary flight power to all AVS subsystems from a single LiPo battery.
ReqParent: SYS-FR-003
Scope: [AVS]
Section: AVS Power
Status: APPROVED

### 11.2 [AVS-PW-FR-002] The Power subsystem shall provide regulated 5V DC power to the Flight Computer via BEC during flight.
ReqParent: AVS-CP-IR-002
Scope: [AVS]
Section: AVS Power
Status: APPROVED

### 11.3 [AVS-PW-PR-001] The Power subsystem shall provide sufficient capacity to satisfy SYS-PR-001 minimum flight duration under full payload load.
ReqParent: SYS-PR-001
Scope: [AVS]
Section: AVS Power
Status: APPROVED

### 11.4 [AVS-PW-IR-001] The Power subsystem shall be implemented using a 4S 3300mAh LiPo as the baseline power source.
ReqParent: SYS-FR-003
Scope: [AVS]
Section: AVS Power
Status: APPROVED

## 12 [#75] Data Link (Container)

### 12.1 [DL-FR-001] The Data Link shall provide a bidirectional communication channel between the GCS and AVS supporting MAVLink telemetry, IQ data streaming, and LIDAR data transfer.
ReqParent: SYS-FR-003
Scope: [DL]
Section: Data Link
Status: APPROVED

### 12.2 [DL-FR-002] The Data Link shall support WiFi as the primary link architecture.
ReqParent: GCS-FT-IR-001
Scope: [DL]
Section: Data Link
Status: APPROVED

### 12.3 [DL-FR-003] The Data Link shall support RFD900x radio as a configurable contingency link for MAVLink telemetry in environments where WiFi is unavailable or unreliable.
ReqParent: GCS-FT-IR-001
Scope: [DL]
Section: Data Link
Status: APPROVED

### 12.4 [DL-FR-004] The Data Link shall maintain continuous MAVLink telemetry for the duration of each mission.
ReqParent: GCS-FT-FR-001
Scope: [DL]
Section: Data Link
Status: APPROVED

### 12.5 [DL-PR-001] The Data Link shall sustain end-to-end command and telemetry latency not exceeding 500ms under nominal link conditions per SYS-PR-002.
ReqParent: SYS-PR-002
Scope: [DL]
Section: Data Link
Status: APPROVED

### 12.6 [DL-PR-002] The Data Link shall support simultaneous MAVLink telemetry and IQ data streaming without throughput degradation to either channel.
ReqParent: SYS-PR-002
Scope: [DL]
Section: Data Link
Status: APPROVED

### 12.7 [DL-IR-001] The Data Link shall interface with the GCS Flight Telemetry subsystem on the ground segment side.
ReqParent: SYS-FR-003
Scope: [DL]
Section: Data Link
Status: APPROVED

### 12.8 [DL-IR-002] The Data Link shall interface with the AVS Flight Computer subsystem on the aerial vehicle side.
ReqParent: SYS-FR-003
Scope: [DL]
Section: Data Link
Status: APPROVED